# Grasshopper definition ladybug_test01.gh (Grasshopper 1.0.7)

# ---- group: RH_IN:201:Z
number_slider = Slider(41.71, range=1..50)

# ---- group: RH_IN:201:H_st
number_slider_2 = Slider(7, range=0..24)

# ---- group: RH_IN:201:D_st
number_slider_3 = Slider(1, range=1..31)

# ---- group: RH_IN:201:M_st
number_slider_4 = Slider(1, range=1..12)

# ---- group: RH_IN:201:M_ed
number_slider_5 = Slider(1, range=1..12)

# ---- group: RH_IN:201:Y
branch_length = Slider(10, range=0..10)

# ---- group: RH_IN:201:D_ed
number_slider_6 = Slider(3, range=1..31)

# ---- group: RH_IN:201:H_ed
number_slider_7 = Slider(16, range=0..24)

# ---- group: RH_IN:201:X
cell_radius = Slider(6.57, range=0..10)

# ----
path = FilePath("C:\work\work\test-02\JPN_KN_Yokohama.476700_JGMY.epw")
box = DomainBox(Base=PlaneXY(0, 0, 0), X=cell_radius, Y=branch_length, Z=number_slider)
analysisperiod = LBAnalysisPeriod(
    start_month=number_slider_4,
    start_day=number_slider_3,
    start_hour=number_slider_2,
    end_month=number_slider_5,
    end_day=number_slider_6,
    end_hour=number_slider_7,
    timestep=Slider(1, range=0..24))  # -> period, hoys, dates; plug-in component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
importloc = LBImportLocation(epw_file=path)  # -> location; plug-in component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
brep = Brep([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])
sunpath = LBSunPath(location=importloc, hoys=analysisperiod.hoys, scale=Slider(0.01, range=0..1))  # -> report, vectors, altitudes, azimuths, hoys, sun_pts, analemma, daily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; plug-in component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
legendpar = LBLegendParameters(seg_height=Slider(2, range=0..10))  # -> leg_par; plug-in component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
brep_2 = Brep(box)
geo = Geometry(sunpath.analemma)
geo_2 = Geometry(sunpath.compass)
geo_3 = Geometry(sunpath.title)
pt = Point(sunpath.sun_pts)
geo_4 = Geometry(sunpath.daily)
directsunhours = LBDirectSunHours(
    vectors=flatten(sunpath.vectors),
    geometry=flatten(brep_2),
    context=flatten(brep),
    grid_size=Slider(1, range=0..10),
    offset_dist=Slider(0.01, range=0..1),
    legend_par=legendpar,
    parallel=Toggle(True),
    run=Toggle(True))  # -> report, points, results, mesh, legend, title, int_mtx; plug-in component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
preview = CustomPreview(Geometry=[pt, geo_3, geo, geo_2, geo_4], Material=ColourSwatch(SwatchColor=RGB(150, 150, 150)))
preview_2 = CustomPreview(Geometry=brep, Material=ColourSwatch(SwatchColor=RGBA(255, 255, 255, 89)))
mesh = MeshBrep(
    Brep=brep,
    Settings={GridMaxCount=0, GridMinCount=16, JaggedSeams=False, MaxEdgeLength=0, MinEdgeLength=0.0001, MinTolerance=0, Refine=True, RefineAngle=0, RelativeTolerance=0.65, SimplePlanes=True, Tolerance=0})
mjoin = MeshJoin(Meshes=mesh)

# ---- group: RH_OUT:115:Mesh
mesh_2 = Mesh(directsunhours.mesh)

# ---- group: RH_OUT:115:Context
mesh_3 = Mesh(mjoin)

# ----
preview_3 = CustomPreview(Geometry=mesh_3, Material=ColourSwatch(SwatchColor=RGB(255, 255, 255)))
