# Grasshopper definition test.gh (Grasshopper 1.0.7)

brep = Brep(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)
python = GhPythonScript(x=brep)  # -> out, a, joinedMesh; inputs x: Brep
# ---------- python: Python ----------
__author__ = "watanabe1523"
__version__ = "2021.01.18"

import rhinoscriptsyntax as rs
import Rhino.Geometry as rg

mesh = rg.Mesh.CreateFromBrep(x)
joinedMesh = rg.Mesh()
for m in mesh:
    joinedMesh.Append(m)
# ---------- end python ----------
panel = Panel("-1")
demesh = DeconstructMesh(Mesh=python.joinedMesh)  # -> Vertices, Faces, Colours, Normals
lng = ListLength(List=demesh.Faces)
subtraction = Subtraction(A=lng, B=1)
range = Range(Domain=Domain(0, 1), Steps=subtraction)
face = MeshFace(demesh.Faces)
pdecon = Deconstruct(Point=demesh.Vertices)  # -> XComponent, YComponent, ZComponent
bnd = Bounds(Numbers=pdecon.ZComponent)
remap = RemapNumbers(Value=pdecon.ZComponent, Source=bnd, Target=Domain(0, 1))  # -> Mapped, Clipped
hsl = ColourHSL(Alpha=1, Hue=remap.Mapped, Saturation=1, Luminance=0.5)
panel_2 = Panel(hsl)
conmesh = ConstructMesh(Vertices=demesh.Vertices, Faces=face, Colours=hsl)
python_2 = GhPythonScript(x=hsl)  # -> out, a; inputs x: list of Color
# ---------- python_2: Python ----------
__author__ = "watanabe1523"
__version__ = "2021.01.18"

import rhinoscriptsyntax as rs
import json
a = {}
for i,col in enumerate(x):
    a[i] = {"R": col.R, "G": col.G, "B": col.B}
# ---------- end python_2 ----------
